# Dynamo graph 01_Install_RPW_v1.3.4.dyn (Dynamo 1.3.4.6666)

# note: Dynamo script by @romangolev
# https://github.com/romangolev/dynamo-scripts
code_block = CodeBlock { "C:\\temp\\dynamo-python\\rpw.zip"; "https://raw.githubusercontent.com/romangolev/dynamo-scripts/master/lib/rpw.zip"; }
python_script = Python(IN[0]=code_block.out0, IN[1]=code_block.out1)
# ---------- python_script.python (21 lines) ----------
#   Handling import
import clr
import sys 
sys.path.append("C:\Program Files (x86)\IronPython 2.7\Lib")
import os
import System
import subprocess

file_path = IN[0]
file_link = IN[1]


if not os.path.exists(r'C:\\temp'):
	os.makedirs(r'C:\\temp')
if not os.path.exists(r'C:\\temp\\dynamo-python'):
	os.makedirs(r'C:\\temp\\dynamo-python')

subprocess.call("powershell Invoke-WebRequest {} -OutFile {}".format(file_link, file_path), shell=True)


OUT = "Successufully copied library"
# ----------------------------------------
